# Grasshopper definition constructivo2.gh (Grasshopper 0.9.70)

brep = Brep(<brep referenced from the Rhino model>)
mesh = Mesh(<mesh referenced from the Rhino model>)
mesh_2 = Mesh(<mesh referenced from the Rhino model>)

xz = XZPlane(Origin=Point(0, 0, 0))
mshadow = MeshShadow(Mesh=mesh_2, Light=xz, Plane=PlaneXY(0, 0, 0))

xz_2 = XZPlane(Origin=Point(0, 0, 0))
mshadow_2 = MeshShadow(Mesh=mesh_2, Light=Vector(0, 0, -1), Plane=xz_2)

solid_cork_rail = Slider(25, range=0..40)
xy = XYPlane(Origin=Point(0, 0, 0))
offset = Offset(Curve=mshadow_2, Distance=solid_cork_rail, Plane=xy, Corners=1)

security_xy_margins = Slider(-3, range=-3..-2)
xy_2 = XYPlane(Origin=Point(0, 0, 0))
offset_2 = Offset(Curve=mshadow_2, Distance=security_xy_margins, Plane=xy_2, Corners=1)

security_xy_margins_2 = Slider(2, range=2..3)
xy_3 = XYPlane(Origin=Point(0, 0, 0))
offset_3 = Offset(Curve=mshadow, Distance=security_xy_margins_2, Plane=xy_3, Corners=1)

Y = UnitY(Factor=Slider(1000, range=1000..1001))
extr = Extrude(Base=offset_3, Direction=Y)

Z = UnitZ(Factor=Slider(1000, range=1000..1001))
extr_2 = Extrude(Base=offset, Direction=Z)

Z_2 = UnitZ(Factor=Slider(1000, range=1000..1001))
extr_3 = Extrude(Base=offset_2, Direction=Z_2)

sdiff = SolidDifference(BrepsA=brep, BrepsB=extr)

split = SplitBrep(Brep=brep, Cutter=extr_2)
split_2 = SplitBrep(Brep=sdiff, Cutter=extr_3)
